# Grasshopper definition Kinect-ICP_V0.1.gh (Grasshopper 1.0.7)
# plug-ins: MetaHopper, EleFront, AzureKinect, Volvox, Heteroptera, Hops, Sasquatch

bool_userchoice = BooleanToggle(False)
# Given a version number MAJOR.MINOR.PATCH, increment the:
# 
# MAJOR version when you make incompatible API changes,
# MINOR version when you add functionality in a backwards-compatible manner, and
# PATCH version when you make backwards-compatible bug fixes.
# Created by: Nathan Barnes
# Date:
# Project:
# Contact Info: nbarnes@azahner.com
# Contributors:
# Comments:
_001_description = Slider(63, range=0..100)

# ---- group: _in
# info: Blue indicates Variables and Input Geo that should not be changed
text_variablename = Panel("Hard Coded Variable")

# ----
# info: Options are User-Driven variables
# info: Key - Explains color and formatting
# conventions in the document
type_referencedgeometry = Curve()
text_variablename_2 = Data(text_variablename)

# ----
# Color Key
# goal: development goal or question needing checking
# info: Cyan: Script Output for visual check
# info: Title Text Lower Left -
# Subtext for explaining group functionality
# (short description of what this block does)
text_variablename_3 = Data(text_variablename_2)
text_variablename_4 = Panel(text_variablename_3)

# ---- group: _out
type_referencedgeometry_2 = EFDataDescription(type_referencedgeometry)

# ----
# RHINO FILE:
toggle = GroupToggle(ToggleActive=True, ToggleVisible=False)  # disabled
# Changelog: 1. Change your personal details in the Title Block
# 
# 2. Save your own version locally
# 
# 3. Set up GH to load this template when starting new files:
# - File>Preferences>Files>Template File
scribbles = GetScribbles()  # -> Scribbles, ScribbleText, ScribblePlane, ScribbleSize; disabled
panel = Panel("RHINO FILE:")  # disabled
tmatch = MatchText(Text=scribbles.ScribbleText, Pattern="RHINO FILE:*", Case=True)  # disabled
c_script = CSharpScript()  # -> out, A; disabled
# ---------- c_script: C# ----------
A = RhinoDocument.Path;
# ---------- end c_script ----------
cull = CullPattern(List=scribbles.Scribbles, CullPattern=tmatch)  # disabled
concat = Concatenate(FragmentA=panel, FragmentB=c_script.A)  # disabled
setscribble = SetScribbleProperties(Scribble=cull, ScribbleText=concat)  # disabled

geo = Geometry(<curve referenced from the Rhino model>)
end = EndPoints(Curve=geo)  # -> Start, End
vec2pt = Vector2Pt(PointA=end.Start, PointB=end.End, Unitize=False)  # -> Vector, Length
panel_2 = Panel(vec2pt.Vector)
panel_3 = Panel(end.End)
# Wide mode if target is close to the camera, Narrow mode if target is further.
capture_frame_rate = ValueList({"Wide 1024px": 0, "Wide 512px": 1, "Narrow 640px": 2, "Narrow 320px": 3}, selected="Narrow 320px")
sourcegeo = Geometry([<mesh referenced from the Rhino model> x1267])
capture_frame_rate_2 = ValueList({"5 fps": 0, "15 fps": 1, "30 fps": 2}, selected="30 fps")

toggle_2 = GroupToggle(ToggleActive=True, ToggleVisible=False)  # disabled
panel_4 = Panel("RHINO FILE:*")  # disabled
open_rhino = BooleanToggle(False)  # disabled
scribbles_2 = GetScribbles()  # -> Scribbles, ScribbleText, ScribblePlane, ScribbleSize; disabled
tmatch_2 = MatchText(Text=scribbles_2.ScribbleText, Pattern=panel_4, Case=True)  # disabled
panel_5 = Panel(":")  # disabled
cull_2 = CullPattern(List=scribbles_2.ScribbleText, CullPattern=tmatch_2)  # disabled
split = TextSplit(Text=cull_2, Separators=panel_5)  # disabled
split_2 = SplitList(List=split, Index=1)  # -> ListA, ListB; disabled
join = TextJoin(Text=split_2.ListB, Join=panel_5)  # disabled
python = GhPythonScript(FilePath=join, Bool=open_rhino)  # inputs Bool: Boolean; disabled
# ---------- python: Python ----------
"""Script to open rhino file
    added space exception
    """

__author__ = "nbarnes"
__version__ = "2019.05.01"

import rhinoscriptsyntax as rs
import Rhino as r


def addDocEvent(sender,e):
    # Update this GH component 
    #ghenv.Component.ExpireSolution(False)
    ghenv.Component.ExpireSolution(True)
    



#r.RhinoApp.Initialized += addDocEvent
#r.RhinoDoc.IsInitializing += addDocEvent

#ghenv.Component.ExpireSolution(True)

#print "Open {0}".format(FilePath)
if Bool:
    
    #r.RhinoDoc.Open(FilePath)
    print FilePath
    rs.Command("!_-Open No " + '"' + "{0}".format(FilePath) + '"')
    #r.RhinoDoc.OpenFile(FilePath)
    ##ghenv.Component.ExpireSolution(True)
# ---------- end python ----------

ptcloud = BooleanToggle(True)
start = BooleanToggle(False)
# Source:
#  -https://andrewjinho.com/author/andrewjinho/
# 
# -https://www.food4rhino.com/en/app/azure-kinect-gh
trigger = Trigger(Interval=2000, TimerInterval=2000, Target=azurekinect)  # disabled
ransac = BooleanToggle(False)
vsub = VoxelSubsampling(Size=".1")
azurekinect = AzureKinect(Active=start, PointCloud=ptcloud, BodyTracker=False, FrameRate=capture_frame_rate_2, DepthMode=capture_frame_rate)  # -> Message, PointCloud, SkeletonPoints, SkeletonConnections
halfsphere = Geometry(<brep referenced from the Rhino model>)
sphere = Geometry(<brep referenced from the Rhino model>)
pigeo = Geometry(<brep referenced from the Rhino model>)
geo_2 = Geometry(<brep referenced from the Rhino model>)
panel_6 = Panel(azurekinect.Message)
box = BooleanToggle(True)
sourcegeo_2 = Geometry(sphere)
scannerpint = Geometry(<point referenced from the Rhino model>)
bcrop = BoxCrop(Box=geo_2)
cloud = ConstructCloud(Points=azurekinect.PointCloud)

debrep = DeconstructBrep(Brep=sourcegeo_2)  # -> Faces, Edges, Vertices
shrinkfaces = ShrinkTrimmedFaces(Brep=debrep.Faces)
evalsrf = EvaluateSurface(Surface=reparameterize(shrinkfaces), Point=".5,.5")  # -> Point, Normal, UDirection, VDirection, Frame
data = Data(evalsrf.Point)
ln = Line(StartPoint=scannerpint, EndPoint=evalsrf.Point)
graft = GraftParallel(PrimaryData=ln, SecondaryData1=debrep.Faces)  # -> PrimaryData, SecondaryData1
addition = Addition(A=".125", B=0.25)
neg = Negative(Value=".125")
panel_7 = Panel("-10")
ext = ExtendCurve(Curve=graft.PrimaryData, Type=0, Start=neg, End=neg)
len = Length(Curve=ext)
ivray = IsoVistRay(Sample=ext, Radius=1000000, Obstacles=graft.SecondaryData1)  # -> Point, Distance, Index
pshift = ShiftPaths(Data=ext, Offset=-1)
smaller = SmallerThan(FirstNumber=ivray.Distance, SecondNumber=len)  # -> SmallerThan, OrEqualTo
shiftm = ShiftMatch(Data=smaller.SmallerThan, Guide=pshift)
cull_3 = CullPattern(List=pshift, CullPattern=shiftm)
intersecting_lines = Data(cull_3)
preview = CustomPreview(Geometry=intersecting_lines, Material=ColourSwatch(SwatchColor=RGB(255, 255, 255)))

pt = Point(azurekinect.PointCloud)  # disabled
pdecon = Deconstruct(Point=pt)  # -> XComponent, YComponent, ZComponent; disabled
mm = Panel("1/25")
panel_8 = Panel(".3")  # disabled
cloudx = CloudEngineX(Cloud=cloud, Run=Toggle(True), Abort=False, Instruction0=bcrop, showinfo=True)
mm_2 = Panel("0.0393701")
toggle_3 = BooleanToggle(True)
extremums = MinMax(Number=pdecon.YComponent)  # -> Minimum, Maximum; disabled
num = Number(mm_2)
group_names_to_ignore = Panel("_ignore")

# ---- group: Canvas Settings / _in
change_background_color = Button()
update_wires_and_groups = Button()

# ----
gradient = Gradient(
    LowerLimit=0,
    UpperLimit=extremums.Maximum,
    Parameter=pdecon.YComponent,
    stops=[0: RGB(237, 24, 0), 0.25: RGB(255, 144, 68), 0.5: RGB(253, 201, 45), 0.75: RGB(108, 250, 170), 1: RGB(65, 177, 244)])  # disabled

# ----
# Do not copy/modify/remove this
# component without setting enable to false first!
out_outputs = ColourSwatch(SwatchColor=RGBA(255, 144, 54, 150))
g_general = ColourSwatch(SwatchColor=RGBA(217, 217, 217, 150))
i_inputs = ColourSwatch(SwatchColor=RGBA(54, 255, 57, 150))
wires_and_groups = CSharpScript(Colors=[i_inputs, out_outputs, g_general], Enable=Toggle(False), debug=Toggle(False))  # -> out; inputs Colors: list of Color, Enable: Boolean, debug: Boolean
# ---------- wires_and_groups: C# usings ----------
using System.Linq;
using System.Text;
# ---------- wires_and_groups: C# ----------
    msg.Clear();
    _debug = debug; //Set to true to have all events printed in rhino log

    if (Enable)
    {
      SetupDict(); // Create a dictionary of the input swatches
      SetEventHandlers(); // This would do the job.
    }
    else
    {
      RemoveEventHandlers();
    }

    Print(msg.ToString());


    // Component setup
    Component.Description = "Set up event handlers to color groups based on prefixes such as 'in_' and 'out_'.\n"
      + "Please insert only swatcheds directly into the Colors input\n"
      + "MIT License. Copyright Mathias Sønderskov Schaltz 2022";
    Component.Params.Input[0].Description = "Please insert only swatcheds directly into the Colors input.\nRemember to rename them";
    Component.Params.Input[1].Description = "Toggle to run...";
    Component.Params.Input[2].Description = "Set debug to true to get all the events printed in the rhino log";
# ---------- wires_and_groups: C# additional code ----------
  Dictionary<string, System.Drawing.Color> colorDict = new Dictionary<string, System.Drawing.Color>();
  StringBuilder msg = new StringBuilder();
  bool _debug = false;


  public void SetupDict()
  {
    colorDict.Clear();
    // Get all inputs to "Colors"
    IList<IGH_Param> colorSources = this.Component.Params.Input[0].Sources;
    if (colorSources.Count == 0)
    {
      throw new Exception("You forgot to setup the colors. Please input swatch components and rename them");
    }
    foreach(IGH_Param source in colorSources)
    {
      //if (source.Type.ToString() == "Grasshopper.Kernel.Types.GH_Colour")
      if (source is Grasshopper.Kernel.Special.GH_ColourSwatch)
      {
        string nickName = source.NickName.Split('_')[0].Trim() + '_';
        if(!colorDict.ContainsKey(nickName))
        {
          Grasshopper.Kernel.Special.GH_ColourSwatch swatch = (Grasshopper.Kernel.Special.GH_ColourSwatch) source;
          colorDict.Add(nickName, swatch.SwatchColour);
        }
        else
        {
          throw new Exception("Multiple swatches using the same name detected. Please rename");
        }
      }
      else
      {
        throw new Exception("Whacko! Why did you input a non-swatch into the Colors? " + source.Type.ToString());
      }

    }

    msg.AppendFormat("Set up the dictionaries with {0} colors\n", colorDict.Count);
    foreach(var pairs in colorDict)
    {
      msg.AppendFormat("{0} -> {1}\n", ("\"" + pairs.Key + "\"").PadRight(5 + colorDict.Keys.Select(k => k.Length).Max()), pairs.Value);
    }
  }

  public void SetEventHandlers()
  {

    // Always remove events first to avoid duplicates
    GrasshopperDocument.ObjectsAdded -= OnObjectsAdded;
    GrasshopperDocument.ObjectsDeleted -= OnObjectsRemoved;
    GrasshopperDocument.ObjectsDeleted -= DeleteThisComponent;

    // Attach events
    GrasshopperDocument.ObjectsAdded += OnObjectsAdded;
    GrasshopperDocument.ObjectsDeleted += OnObjectsRemoved;
    GrasshopperDocument.ObjectsDeleted += DeleteThisComponent;


    foreach(Grasshopper.Kernel.Special.GH_Group grp in GrasshopperDocument.Objects.OfType<Grasshopper.Kernel.Special.GH_Group>())
    {
      grp.ObjectChanged -= ColorGroup;
      grp.ObjectChanged += ColorGroup;

      ColorGroup(grp, null); // Make sure to run it once
    }
    msg.AppendFormat("Added the eventhandlers on {0} existing groups and on future created groups", GrasshopperDocument.Objects.OfType<Grasshopper.Kernel.Special.GH_Group>().Count());
  }

  public void OnObjectsAdded(object sender, GH_DocObjectEventArgs e)
  {
    bool any = false;
    foreach (Grasshopper.Kernel.Special.GH_Group grp in e.Objects.OfType<Grasshopper.Kernel.Special.GH_Group>())
    {
      grp.ObjectChanged -= ColorGroup;
      grp.ObjectChanged += ColorGroup;
      any = true;
    }

    DebugWrite(any ? "Group Objects Added: Attaching Events to ObjectChanged" : "Objects Added - but no groups");
  }

  //Same but reversed
  public void OnObjectsRemoved(object sender, GH_DocObjectEventArgs e)
  {
    bool any = false;
    foreach (Grasshopper.Kernel.Special.GH_Group grp in e.Objects.OfType<Grasshopper.Kernel.Special.GH_Group>())
    {
      grp.ObjectChanged -= ColorGroup;
      any = true;
    }

    DebugWrite(any ? "Group Objects Removed, removing event" : "Objects Removed - although not a group");

  }



  public void RemoveEventHandlers()
  {
    GrasshopperDocument.ObjectsAdded -= OnObjectsAdded;
    GrasshopperDocument.ObjectsDeleted -= OnObjectsRemoved;


    foreach(Grasshopper.Kernel.Special.GH_Group grp in GrasshopperDocument.Objects.OfType<Grasshopper.Kernel.Special.GH_Group>())
    {
      grp.ObjectChanged -= ColorGroup;

    }
    msg.AppendFormat("Removed event handlers on document and on {0} groups\n", GrasshopperDocument.Objects.OfType<Grasshopper.Kernel.Special.GH_Group>().Count());

  }

  public void ColorGroup(object sender, EventArgs e)
  {

    Grasshopper.Kernel.Special.GH_Group grp = sender as Grasshopper.Kernel.Special.GH_Group;
    if (grp == null) return; //not type GH_Group
    //if (!grp.NickName.EndsWith("_")) return;


    string prefix = grp.NickName.Split('_')[0].Trim() + '_';

    string prefixes = String.Join(", ", colorDict.Keys.Select(k => "\"" + k + "\""));


    if (colorDict.ContainsKey(prefix))
    {
      if (grp.NickName.EndsWith("_"))
        grp.Colour = colorDict[prefix];
      grp.NickName = grp.NickName.Replace(prefix, "");

      DebugWrite("Colored " + grp.NickName);

    }
    else
    {
      //DebugWrite("Group changed but not relevant: prefix " + prefix + " is not among " + prefixes);
    }

  }
  public void DebugWrite(string msg)
  {
    if (_debug)
    {
      Rhino.RhinoApp.WriteLine(msg);
    }
  }

  public void DeleteThisComponent(object sender, GH_DocObjectEventArgs e)
  {

    if (e.Objects.OfType<Grasshopper.Kernel.GH_Component>().Where(o => o.NickName == this.Component.NickName).Any())
    {
      DebugWrite("Removed template component. Removing all the eventhandlers");
      RemoveEventHandlers();
    }


  }
# ---------- end wires_and_groups ----------
panel_9 = Panel(wires_and_groups)

panel_10 = Panel(cloudx)
scale = Scale(Geometry=cloudx, Center=Point(0, 0, 0), Factor=mm_2)  # -> Geometry, Transform
cloude = CloudEngine(Cloud=scale.Geometry, Instruction0=vsub)
decloud = DeconstructCloud(Cloud=cloude)  # -> Points, Normals, Colors
target_pointcloud = Data(decloud.Points)
preview_2 = CustomPreview(Geometry=pt, Material=gradient)  # disabled
color = ColourSwatch(SwatchColor=RGB(130, 130, 130))

# ---- group: Canvas Settings
group_names_corresponding_to_colors_belo = Panel("""_in
_out
_analysis
_goal
_visual""")  # "Group names corresponding to colors below"
groups_with_hidden_wires = Panel("_visual")
color_2 = ColourSwatch(SwatchColor=RGBA(0, 0, 0, 150))
color_3 = ColourSwatch(SwatchColor=RGBA(64, 0, 255, 150))
color_4 = ColourSwatch(SwatchColor=RGBA(120, 6, 6, 150))
color_5 = ColourSwatch(SwatchColor=RGBA(0, 255, 153, 150))
merge = Merge(Data1=color_2, Data2=color_3, Data3=color_4, Data4=color_5)
default_color = ColourSwatch(SwatchColor=RGBA(227, 227, 227, 90))
bool = Boolean(invert(update_wires_and_groups))
changebackground = GhPythonScript(
    change=change_background_color,
    newBackgroundColor=color,
    wireColor=RGB(110, 110, 110),
    selectedWireColor=RGB(47, 255, 0))  # inputs newBackgroundColor: Color, wireColor: Color, selectedWireColor: Color
# ---------- changebackground: Python ----------
"""
    Expanded by Nathan Barnes - AZahner
"""

import Grasshopper as gh
import rhinoscriptsyntax as rs

newShadeColor = rs.CreateColor(0,0,0,20)
newEdgeColor = rs.CreateColor(0,0,0,40)

if(change):
     gh.GUI.Canvas.GH_Skin.canvas_back = newBackgroundColor
     gh.GUI.Canvas.GH_Skin.canvas_shade = newShadeColor
     gh.GUI.Canvas.GH_Skin.canvas_edge = newEdgeColor
     gh.GUI.Canvas.GH_Skin.wire_default = wireColor
     gh.GUI.Canvas.GH_Skin.wire_selected_a = selectedWireColor
     gh.GUI.Canvas.GH_Skin.wire_selected_b = selectedWireColor
# ---------- end changebackground ----------
group_color = GroupColor(
    run=bool,
    groupNames=group_names_corresponding_to_colors_belo,
    groupNamesIgnore=group_names_to_ignore,
    colors=merge,
    defaultColor=default_color)  # inputs run: Boolean, groupNames: list of String, groupNamesIgnore: list of String, colors: list of Color, defaultColor: Color
# ---------- group_color: C# usings ----------
using System.Drawing;
using Grasshopper.Kernel.Special;
# ---------- group_color: C# ----------
    // Created by Timo Harboe Nielsen - Rambøll.
    // Expanded by Nathan Barnes - AZahner

    if(!run){
      return;
    }
    GH_Document doc = owner.OnPingDocument();
    foreach (var dobj in doc.Objects)
    {
      GH_Group _group = dobj as GH_Group;
      if( _group == null){
        continue;
      }
      string groupName = _group.NickName.ToString();

      bool changeColor = true;
      //Check if groupName is to be ignored
      for(int i = 0; i < groupNamesIgnore.Count; i++){
        string compareName = groupNamesIgnore[i];
        if(groupName.IndexOf(compareName, StringComparison.OrdinalIgnoreCase) >= 0){
          changeColor = false;
        }
      }

      if(!changeColor){continue;}

      for(int i = 0; i < Math.Min(groupNames.Count, colors.Count); i++){
        string compareName = groupNames[i];
        if(groupName.IndexOf(compareName, StringComparison.OrdinalIgnoreCase) >= 0){
          _group.Colour = colors[i];
          break;
        } else{
          _group.Colour = defaultColor;
        }
      }
    }
# ---------- end group_color ----------
wdt = FaintWires(updateWires=bool, hiddenGroups=groups_with_hidden_wires)  # inputs updateWires: Boolean, hiddenGroups: list of String
# ---------- wdt: C# usings ----------
using System.IO;
using System.Linq;
using System.Data;
using System.Drawing;
using System.Reflection;
using System.Windows.Forms;
using System.Xml;
using System.Xml.Linq;
using System.Runtime.InteropServices;

using Rhino.DocObjects;
using Rhino.Collections;
using GH_IO;
using GH_IO.Serialization;

using Grasshopper.Kernel.Special;
# ---------- wdt: C# ----------
    //Get ID's of objects in desired groups

    GH_Document doc = owner.OnPingDocument();
    List<System.Guid> objectIDs = new List<System.Guid>();
    foreach (var dobj in doc.Objects)
    {

      GH_Group _group = dobj as GH_Group;
      if( _group == null){
        continue;
      }
      for(int i = 0; i < hiddenGroups.Count; i++){
        string groupName = _group.NickName.ToString();
        string compareName = hiddenGroups[i];
        if(groupName.IndexOf(compareName, StringComparison.OrdinalIgnoreCase) >= 0){
          objectIDs.AddRange(_group.ObjectIDs);
          break;
        }
      }
    }

    // Manipulate wires
    foreach(IGH_ActiveObject activeObject in GrasshopperDocument.ActiveObjects()){
      if(activeObject.SubCategory == "Primitive" || activeObject.SubCategory == "Geometry"){
        if(activeObject is IGH_Param){
          IGH_Param param = activeObject as IGH_Param;
          int wire = 0;  //0 default, 1 faint, 2 hidden
          for(int i = 0; i < param.SourceCount; i++){
            IGH_ActiveObject activeObjectSource = param.Sources[i].Attributes.GetTopLevel.DocObject as IGH_ActiveObject;
            if(activeObjectSource.SubCategory == "Primitive" || activeObjectSource.SubCategory == "Geometry"){
              if(objectIDs.Contains(activeObject.InstanceGuid) && !objectIDs.Contains(activeObjectSource.InstanceGuid)){
                wire = 2;
              } else {
                wire = 1;
              }
            } else{
              wire = 0;
              break;
            }
          }
          if(wire == 1){
            fixWires(param, updateWires);
          }
          if(wire == 2){
            hideWires(param, updateWires);
          }

        }
      }
    }
# ---------- wdt: C# additional code ----------
  void fixWires(IGH_Param param, bool showFaint){
    if(showFaint){
      param.WireDisplay = GH_ParamWireDisplay.faint;
    } else{
      GH_ParamWireDisplay ParameterDisplayDefault = (GH_ParamWireDisplay) 0;
      param.WireDisplay = ParameterDisplayDefault;
    }
  }

  void hideWires(IGH_Param param, bool showFaint){
    if(showFaint){
      param.WireDisplay = GH_ParamWireDisplay.hidden;
    } else{
      GH_ParamWireDisplay ParameterDisplayDefault = (GH_ParamWireDisplay) 0;
      param.WireDisplay = ParameterDisplayDefault;
    }
  }
# ---------- end wdt ----------

# ----
cull_4 = CullPattern(List=debrep.Faces, CullPattern=invert(shiftm))
cull_5 = CullPattern(List=pshift, CullPattern=invert(shiftm))
join_2 = BrepJoin(Breps=cull_4)  # -> Breps, Closed
intersecting_lines_2 = Data(cull_5)
preview_3 = CustomPreview(Geometry=intersecting_lines_2, Material=ColourSwatch(SwatchColor=RGB(8, 255, 0)))
filter = StreamFilter(Gate=box, Stream1=sourcegeo_2)
data_2 = Data(target_pointcloud)
vsub_2 = VoxelSubsampling(Size=".1")
pi = Panel("500")
pi_2 = Panel(".5")
panel_11 = Panel("http://127.0.0.1:5001/icpE")
source = Data(filter)
target = Data(sourcegeo_2)
avr = Average(Input=target_pointcloud)
preview_4 = CustomPreview(Geometry=source, Material=ColourSwatch(SwatchColor=RGB(255, 0, 0)))

# ----
# Writes point data to file
debrep_2 = DeconstructBrep(Brep=join_2.Breps)  # -> Faces, Edges, Vertices
source_2 = Data()
panel_12 = Panel("""# .PCD v.7 - Point Cloud Data file format
VERSION .7
FIELDS x y z
SIZE 4 4 4
TYPE F F F
COUNT 1 1 1
WIDTH {0}
HEIGHT 1
VIEWPOINT 0 0 0 1 0 0 0
POINTS {0}
DATA ascii""")
lng = ListLength(List=data_2)
pdecon_2 = Deconstruct(Point=data_2)  # -> XComponent, YComponent, ZComponent
format = Format(Format=panel_12, Culture=127, Data0=lng)
format_2 = Format(Format="{0} {1} {2}", Culture=127, Data0=pdecon_2.XComponent, Data1=pdecon_2.YComponent, Data2=pdecon_2.ZComponent)
merge_2 = Merge(Data1=format, Data2=format_2)
join_3 = TextJoin(Text=merge_2)

dim = Dimensions(Surface=debrep_2.Faces)  # -> UDimension, VDimension
multiplication = Multiplication(A=dim.VDimension, B="5")
multiplication_2 = Multiplication(A=dim.UDimension, B="5")
sdivide = DivideSurface(Surface=debrep_2.Faces, UCount=multiplication_2, VCount=multiplication)  # -> Points, Normals, Parameters
filter_2 = StreamFilter(Gate=box, Stream0=source_2, Stream1=sdivide.Points)  # -> flatten(Stream)
clean = CleanTree(RemoveNulls=True, RemoveInvalid=True, RemoveEmpty=False, Tree=filter_2)
lng_2 = ListLength(List=clean)
panel_13 = Panel(lng_2)
cloud_2 = ConstructCloud(Points=clean)
cloude_2 = CloudEngine(Cloud=cloud_2, Instruction0=vsub_2)
decloud_2 = DeconstructCloud(Cloud=cloude_2)  # -> Points, Normals, Colors

merge_3 = Merge(Data1=debrep_2.Vertices, Data2=sdivide.Points)  # -> flatten(Result)
pdecon_3 = Deconstruct(Point=decloud_2.Points)  # -> XComponent, YComponent, ZComponent
lng_3 = ListLength(List=decloud_2.Points)
format_3 = Format(Format=panel_12, Culture=127, Data0=lng_3)
format_4 = Format(Format="{0} {1} {2}", Culture=127, Data0=pdecon_3.XComponent, Data1=pdecon_3.YComponent, Data2=pdecon_3.ZComponent)
merge_4 = Merge(Data1=format_3, Data2=format_4)
join_4 = TextJoin(Text=merge_4)

panel_14 = Panel(lng_3)
hops = Hops(
    Run=ransac,
    PtToMatch=join_3,
    PtToOrient=join_4,
    IcpThreshold=".125",
    IcpMax_iteration="5",
    CacheResultsInMemory=False,
    CacheSolveResults=False,
    RemoteDefinitionLocation="http://127.0.0.1:5001/icp",
    RemoteSolveVersion=(0, 1, 0),
    ShowInput_Enabled=False,
    ShowInput_Path=False,
    SynchronousSolve=False)  # -> FastTransMatrix, TransMatrix, Result_ransac
data_3 = Data(hops.TransMatrix)
panel_15 = Panel(hops.Result_ransac)
data_4 = Data(hops.FastTransMatrix)

# ----
# Transform Fast
panel_16 = Panel("""[
 
]""")
rep = ReplaceText(Text=data_4, Find=",", RecursiveReplace=False)
split_3 = TextSplit(Text=rep, Separators=panel_16)  # -> flatten(Result)
len_2 = TextLength(Text=split_3)
smaller_2 = SmallerThan(FirstNumber=len_2, SecondNumber=1)  # -> SmallerThan, OrEqualTo
cull_6 = CullPattern(List=split_3, CullPattern=invert(smaller_2.SmallerThan))
num_2 = Number(cull_6)
matrix = ConstructMatrix(Rows="4", Columns="4", Values=num_2)
xy = XYPlane(Origin=Point(0, 0, 0))
transform = Transform(Geometry=xy, Transform=matrix)
orient = Orient(Geometry=source, Source=transform, Target=PlaneXY(0, 0, 0))  # -> Geometry, Transform
preview_5 = CustomPreview(Geometry=orient.Geometry, Material=ColourSwatch(SwatchColor=RGB(69, 62, 62)))

# ----
# ICP Transform
panel_17 = Panel("""[
 
]""")
rep_2 = ReplaceText(Text=data_3, Find=",", RecursiveReplace=False)
split_4 = TextSplit(Text=rep_2, Separators=panel_17)  # -> flatten(Result)
len_3 = TextLength(Text=split_4)
smaller_3 = SmallerThan(FirstNumber=len_3, SecondNumber=1)  # -> SmallerThan, OrEqualTo
cull_7 = CullPattern(List=split_4, CullPattern=invert(smaller_3.SmallerThan))
num_3 = Number(cull_7)
matrix_2 = ConstructMatrix(Rows="4", Columns="4", Values=num_3)
xy_2 = XYPlane(Origin=Point(0, 0, 0))
transform_2 = Transform(Geometry=xy_2, Transform=matrix_2)
orient_2 = Orient(Geometry=source, Source=transform_2, Target=PlaneXY(0, 0, 0))  # -> Geometry, Transform
preview_6 = CustomPreview(Geometry=orient_2.Geometry, Material=ColourSwatch(SwatchColor=RGB(138, 62, 62)))

data_5 = Data(orient_2.Geometry)  # disabled
brep_cp = BrepClosestPoint(Point=target_pointcloud, Brep=data_5)  # -> Point, Normal, Distance; disabled
smaller_4 = SmallerThan(FirstNumber=brep_cp.Distance, SecondNumber=panel_8)  # -> SmallerThan, OrEqualTo; disabled
cull_8 = CullPattern(List=brep_cp.Distance, CullPattern=smaller_4.SmallerThan)  # disabled
cull_9 = CullPattern(List=brep_cp.Point, CullPattern=smaller_4.SmallerThan)  # disabled
cull_10 = CullPattern(List=target_pointcloud, CullPattern=smaller_4.SmallerThan)  # disabled
sort = SortList(Keys=cull_8)  # -> reverse(Keys), ValuesA; disabled
ln_2 = Line(StartPoint=cull_9, EndPoint=cull_10)  # disabled
panel_18 = Panel(sort.Keys)  # disabled
to_match_num = Panel(lng)
panel_19 = Panel(data_4)
panel_20 = Panel(data_3)
